# Grasshopper definition workshop-2.gh (Grasshopper 0.9.76)
# plug-ins: Python Interpreter

python = PythonScript(seed=Slider(100, range=0..100), d=Slider(10, range=0..10))  # -> out, x, y, z
# ---------- python: Python ----------
import random

random.seed(seed)

x = random.random() * d
y = random.random() * d
z = random.random() * d
# ---------- end python ----------
pt = ConstructPoint(XCoordinate=0, YCoordinate=0, ZCoordinate=0)
vec = VectorXYZ(XComponent=python.x, YComponent=python.y, ZComponent=python.z)  # -> Vector, Length
python_2 = PythonScript()  # -> out, a
# ---------- python_2: Python ----------
import rhinoscriptsyntax as rs
import scriptcontext as sc
import Rhino

sc.doc = Rhino.RhinoDoc.ActiveDoc

arrObjects = rs.GetObject("Select object")

print arrObjects
# ---------- end python_2 ----------
python_3 = PythonScript()  # -> path
# ---------- python_3: Python ----------
import pickle

path = ghenv.LocalScope.ghdoc.Path
path = path.split("\\")
path = "\\".join(path[:-1]) + "\\"
# ---------- end python_3 ----------
move = Move(Geometry=pt, Motion=vec.Vector)  # -> Geometry, Transform
cyl = Cylinder(Base=pt, Radius=python.x, Length=python.y)
cone = Cone(Base=pt, Radius=python.y, Length=python.z)  # -> Cone, Tip
box = Box2Pt(PointA=pt, PointB=move.Geometry, Plane=PlaneXY(0, 0, 0))
sph = Sphere(Base=pt, Radius=python.z)
cap = CapHoles(Brep=cyl)
cap_2 = CapHoles(Brep=cone.Cone)
python_4 = PythonScript(
    active=Toggle(True),
    path=python_3,
    orbitRes=Slider(2, range=0..10),
    vertRes=Slider(2, range=0..10),
    distMult=Slider(5, range=0..10))  # -> out, pred, conf, obj
# ---------- python_4: Python ----------
import rhinoscriptsyntax as rs
import scriptcontext as sc
import Rhino
from System.Drawing import Rectangle, Point, Size, Color
import math
import time
import subprocess
import os
#import shutil

def runScript():
    
    sc.doc = Rhino.RhinoDoc.ActiveDoc
    obj = rs.GetObject("Select object for prediction")
    
    w = 64
    h = 64
    
    rView = Rhino.RhinoDoc.ActiveDoc.Views.Add("view", Rhino.Display.DefinedViewportProjection.Perspective, Rectangle(Point(100, 100), Size(w, h)), True);
    
    # http://developer.rhino3d.com/api/RhinoCommon/html/T_Rhino_Display_RhinoViewport.htm
    rView.TitleVisible = False
    rView.MainViewport.ConstructionGridVisible = False
    rView.MainViewport.ConstructionAxesVisible = False
    rView.MainViewport.WorldAxesVisible = False
    
    #rView.MainViewport.ChangeToParallelProjection(True)
    #rView.ActiveViewport.ZoomExtents()
    
    Rhino.ApplicationSettings.AppearanceSettings.ViewportBackgroundColor = Color.White
    shaded = Rhino.Display.DisplayModeDescription.FindByName("Shaded")
    rView.ActiveViewport.DisplayMode = shaded
    
    tar = rs.SurfaceVolumeCentroid(obj)[0]
    
    #http://4.rhino3d.com/5/rhinoscript/geometry_methods/boundingbox.htm
    bb = rs.BoundingBox(obj)
    dist = max([bb[1].X - bb[0].X, bb[3].Y - bb[0].Y, bb[4].Z - bb[0].Z]) * distMult
    
    id = str(int(time.time()))
    
    sc.doc = ghdoc
    
    for j in range(int(vertRes)):
        
        z = tar.Z + math.sin(math.pi / 2 * j/float(vertRes)) * dist
        dist_2 = math.cos(math.pi / 2 * j/float(vertRes)) * dist
        
        for i in range(int(orbitRes)):
            
            x = tar.X + math.sin(2 * math.pi * i/float(orbitRes)) * dist_2
            y = tar.Y + math.cos(2 * math.pi * i/float(orbitRes)) * dist_2
            
            pt = rs.coerce3dpoint(rs.AddPoint(x, y, z))
            
            rView.ActiveViewport.SetCameraLocation(pt, False)
            rView.ActiveViewport.SetCameraDirection(tar - pt, True)
            
            Rhino.RhinoDoc.ActiveDoc.Views.Redraw()
            
            size = Size(w, h)
            capture = rView.CaptureToBitmap(size)
            
            capture.Save(path + "-temp//" + "_".join([id, str(j), str(i)]) + ".png")
    
    rView.Close()
    
    
    sshProcess = subprocess.Popen(["ssh", "-p", "2222", "vagrant@127.0.0.1", "-i", "C:\\Users\\danil\\Documents\\GitHub\\dmc\\.vagrant\\machines\\default\\virtualbox\\private_key"], stdin=subprocess.PIPE, stdout=subprocess.PIPE, stderr=subprocess.PIPE, universal_newlines=True)
    sshProcess.stdin.write("cd notebooks/workshop-2\n")
    sshProcess.stdin.write("/home/vagrant/anaconda2/bin/python 03-use_model.py\n")
    sshProcess.stdin.close()
    
    output = []
    
    for line in sshProcess.stdout:
        s = line.split("python: ")
        if len(s) > 1:
            output.append(s[1].strip())
    
    for line in sshProcess.stderr:
        print line
    
    print output
    
    
    folder = path + '-temp'
    for the_file in os.listdir(folder):
        file_path = os.path.join(folder, the_file)
        os.unlink(file_path)
    
    return output[0], output[1], obj

if active:
    pred, conf, objOut = runScript()
    

sc.doc = Rhino.RhinoDoc.ActiveDoc
obj = rs.coercegeometry(objOut)
#obj = objOut
# ---------- end python_4 ----------
python_5 = PythonScript()  # -> out, a
# ---------- python_5: Python ----------
import subprocess

sshProcess = subprocess.Popen(["ssh", "-p", "2222", "vagrant@127.0.0.1", "-i", "C:\\Users\\danil\\Documents\\GitHub\\dmc\\.vagrant\\machines\\default\\virtualbox\\private_key"], stdin=subprocess.PIPE, stdout=subprocess.PIPE, stderr=subprocess.PIPE, universal_newlines=True)
sshProcess.stdin.write("cd notebooks/workshop-2\n")
sshProcess.stdin.write("/home/vagrant/anaconda2/bin/python 03-use_model.py\n")
#sshProcess.stdin.write("/home/vagrant/anaconda2/bin/python\n")
#sshProcess.stdin.write("import sys\n")
#sshProcess.stdin.write("print sys.executable\n")
sshProcess.stdin.close()

output = []

for line in sshProcess.stdout:
#    print line
    s = line.split("python: ")
    if len(s) > 1:
        output.append(s[1].strip())

print output

for line in sshProcess.stderr:
    print line
# ---------- end python_5 ----------
python_6 = PythonScript()  # -> path; same code as python_3
geo = Geometry(python_4.obj)
bbox = BoundingBox(Content=geo, Plane=PlaneXY(0, 0, 0))  # -> Box, Box_2
debox = DeconstructBox(Box=bbox.Box)  # -> Plane, X, Y, Z
wires = BrepWireframe(Brep=bbox.Box, Density=-1)
dedomain = DeconstructDomain(Domain=debox.X)  # -> Start, End
dedomain_2 = DeconstructDomain(Domain=debox.Y)  # -> Start, End
vec_2 = VectorXYZ(XComponent=dedomain.End, YComponent=dedomain_2.Start, ZComponent=0)  # -> Vector, Length
geo_2 = Geometry(cap_2)
move_2 = Move(Geometry=debox.Plane, Motion=vec_2.Vector)  # -> Geometry, Transform
vec_3 = VectorXYZ(XComponent=0, YComponent="-2", ZComponent=0)  # -> Vector, Length
python_7 = PythonScript(
    active=Toggle(False),
    path=python_6,
    obj=geo_2,
    name="cone",
    orbitRes=Slider(10, range=0..10),
    vertRes=Slider(5, range=0..10),
    distMult=Slider(5, range=0..10))  # -> out, pts
# ---------- python_7: Python ----------
import rhinoscriptsyntax as rs
import scriptcontext as sc
import Rhino
from System.Drawing import Rectangle, Point, Size, Color
import math
import time

def runScript():

    sc.doc = ghdoc
    layer = str(Rhino.RhinoDoc.ActiveDoc.Layers.CurrentLayer)
    doc_object = rs.coercerhinoobject(obj)
    
    geometry = doc_object.Geometry
    attributes = doc_object.Attributes
    
    sc.doc = Rhino.RhinoDoc.ActiveDoc
    object = sc.doc.Objects.Add(geometry, attributes)
    #rs.ObjectLayer(rhino_ref, layer)
    
    sc.doc = ghdoc
    
    w = 64
    h = 64
    
    rView = Rhino.RhinoDoc.ActiveDoc.Views.Add("view", Rhino.Display.DefinedViewportProjection.Perspective, Rectangle(Point(100, 100), Size(w, h)), True);
    
    # http://developer.rhino3d.com/api/RhinoCommon/html/T_Rhino_Display_RhinoViewport.htm
    rView.TitleVisible = False
    rView.MainViewport.ConstructionGridVisible = False
    rView.MainViewport.ConstructionAxesVisible = False
    rView.MainViewport.WorldAxesVisible = False
    
    #rView.MainViewport.ChangeToParallelProjection(True)
    #rView.ActiveViewport.ZoomExtents()
    
    Rhino.ApplicationSettings.AppearanceSettings.ViewportBackgroundColor = Color.White
    shaded = Rhino.Display.DisplayModeDescription.FindByName("Shaded")
    rView.ActiveViewport.DisplayMode = shaded
    
    pts = []
    
    tar = rs.SurfaceVolumeCentroid(obj)[0]
    
    #http://4.rhino3d.com/5/rhinoscript/geometry_methods/boundingbox.htm
    bb = rs.BoundingBox(obj)
    dist = max([bb[1].X - bb[0].X, bb[3].Y - bb[0].Y, bb[4].Z - bb[0].Z]) * distMult
    
    id = str(int(time.time()))
    
    for j in range(int(vertRes)):
        
        z = tar.Z + math.sin(math.pi / 2 * j/float(vertRes)) * dist
        dist_2 = math.cos(math.pi / 2 * j/float(vertRes)) * dist
        
        for i in range(int(orbitRes)):
            
            x = tar.X + math.sin(2 * math.pi * i/float(orbitRes)) * dist_2
            y = tar.Y + math.cos(2 * math.pi * i/float(orbitRes)) * dist_2
            
            pt = rs.coerce3dpoint(rs.AddPoint(x, y, z))
            
    #        pts.append(pt)
            
            rView.ActiveViewport.SetCameraLocation(pt, False)
            rView.ActiveViewport.SetCameraDirection(tar - pt, True)
            
            Rhino.RhinoDoc.ActiveDoc.Views.Redraw()
            
            size = Size(w, h)
            capture = rView.CaptureToBitmap(size)
            capture.Save(path + "images//" + "_".join([name, id, str(j), str(i)]) + ".png")
    
    rView.Close()
    
    sc.doc = Rhino.RhinoDoc.ActiveDoc
    objs = rs.ObjectsByLayer(layer)
    rs.DeleteObjects(objs)

if active:
    runScript()
# ---------- end python_7 ----------
concat = Concatenate(FragmentA="confidence: ", FragmentB=python_4.conf)
concat_2 = Concatenate(FragmentA="predicted category: ", FragmentB=python_4.pred)
move_3 = Move(Geometry=move_2.Geometry, Motion=vec_3.Vector)  # -> Geometry, Transform
tag = TextTag3D(Location=move_2.Geometry, Text=concat_2, Size=1, Justification=7)
tag_2 = TextTag3D(Location=move_3.Geometry, Text=concat, Size=1, Justification=7)
